# Dynamo graph InsulationCleanup.dyn (Dynamo 2.6.1.8786)

# group: Input
run_cleanup = BoolSelector(true)  # graph input

# group: Actual Cleanup Implementation
full_insulation_cleanup = Python(IN[0]=run_cleanup)
# ---------- full_insulation_cleanup.python (94 lines) ----------
import collections
import clr
# Import RevitNodes
clr.AddReference("RevitNodes")
import Revit

# Import RevitAPI
clr.AddReference("RevitAPI")
clr.AddReference('RevitAPIUI')
import Autodesk
import Autodesk.Revit.DB as db

# Import Revit elements
from Revit.Elements import *

# Import DocumentManager
clr.AddReference("RevitServices")
import RevitServices
from RevitServices.Persistence import DocumentManager

# important vars, dynamo version
#-------------------------------
doc = DocumentManager.Instance.CurrentDBDocument
uiapp = DocumentManager.Instance.CurrentUIApplication
uidoc = uiapp.ActiveUIDocument
app = uiapp.Application
view = uidoc.ActiveView 

ElementHostPair = collections.namedtuple("ElementHostPair", ["element", "host"])

def query_all_elements_of_category(doc, cat):
    """Return all elements of a category from a document."""
    collector = db.FilteredElementCollector(doc)
    elements = collector.OfCategory(cat)\
                        .WhereElementIsNotElementType()\
                        .ToElements()
    return elements

def find_rogue_and_unhosted_elements(doc, elems):
    """Find all rogue and unhosted insulation elements."""
    unhosted_elements = []
    rogue_elements = []
    for element in elems:
        host_id = element.HostElementId
        host_element = doc.GetElement(host_id)
        if host_element is None:
            unhosted_elements.append(element)
        else:
            if element.WorksetId != host_element.WorksetId:
                rogue_elements.append(ElementHostPair(element, host_element))
    return rogue_elements, unhosted_elements

def cleanup_insulation(pair):
    """Cleanup rogue and unhosted insulation elements."""
    element_workset_id = pair.element.WorksetId.IntegerValue
    host_workset_id = pair.host.WorksetId.IntegerValue
    host_workset_parameter = pair.host.get_Parameter(
        db.BuiltInParameter.ELEM_PARTITION_PARAM)
    host_workset_parameter.Set(element_workset_id)
    host_workset_parameter.Set(host_workset_id)

# Place your code below this line
should_run = IN[0]
success = None

if should_run:
	# STEP 1: Inspect Model and summarize findings
	pipe_insulations = query_all_elements_of_category(doc=doc, cat=db.BuiltInCategory.OST_PipeInsulations)
	duct_insulations = query_all_elements_of_category(doc=doc, cat=db.BuiltInCategory.OST_DuctInsulations)
	rogue_pipe, unhosted_pipe = find_rogue_and_unhosted_elements(doc=doc, elems=pipe_insulations)
	rogue_duct, unhosted_duct = find_rogue_and_unhosted_elements(doc=doc, elems=duct_insulations)
	
	# STEP 2: Clean up insulation
	transaction = db.Transaction(doc)
	transaction.Start("Insulation Cleanup")
	try:
	    for pipe_element in unhosted_pipe:
	        doc.Delete(pipe_element.Id)
	    for pipe_pair in rogue_pipe:
	        cleanup_insulation(pipe_pair)
	    for duct_element in unhosted_duct:
	        doc.Delete(duct_element.Id)
	    for duct_pair in rogue_duct:
	        cleanup_insulation(duct_pair)
	except Exception as exception:
		transaction.RollBack()
		success = False
	else:
		transaction.Commit()
		success = True
        
# Assign your output to the OUT variable.
OUT = success
#OUT = unhosted_pipe
# ----------------------------------------

# group: Reporting
find_all_pipe_insulation = Python()  # frozen; unwired: IN[0]
# ---------- find_all_pipe_insulation.python (43 lines) ----------
import clr
# Import RevitNodes
clr.AddReference("RevitNodes")
import Revit

# Import RevitAPI
clr.AddReference("RevitAPI")
clr.AddReference('RevitAPIUI')
import Autodesk
import Autodesk.Revit.DB as db

# Import Revit elements
from Revit.Elements import *

# Import DocumentManager
clr.AddReference("RevitServices")
import RevitServices
from RevitServices.Persistence import DocumentManager

# important vars, dynamo version
#-------------------------------
doc = DocumentManager.Instance.CurrentDBDocument
uiapp = DocumentManager.Instance.CurrentUIApplication
uidoc = uiapp.ActiveUIDocument
app = uiapp.Application
view = uidoc.ActiveView 


def query_all_elements_of_category(doc, cat):
    """Return all elements of a category from a document."""
    collector = db.FilteredElementCollector(doc)
    elements = collector.OfCategory(cat)\
                        .WhereElementIsNotElementType()\
                        .ToElements()
    return elements

# Place your code below this line
pipe_insulations = query_all_elements_of_category(
        doc=doc, cat=db.BuiltInCategory.OST_PipeInsulations)


# Assign your output to the OUT variable.
OUT = pipe_insulations
# ----------------------------------------
watch = Watch(find_all_pipe_insulation)
find_all_duct_insulation = Python()  # frozen; unwired: IN[0]
# ---------- find_all_duct_insulation.python (46 lines) ----------
import clr
# Import RevitNodes
clr.AddReference("RevitNodes")
import Revit

# Import RevitAPI
clr.AddReference("RevitAPI")
clr.AddReference('RevitAPIUI')
import Autodesk
import Autodesk.Revit.DB as db

# Import Revit elements
from Revit.Elements import *

# Import DocumentManager
clr.AddReference("RevitServices")
import RevitServices
from RevitServices.Persistence import DocumentManager

# important vars, dynamo version
#-------------------------------
doc = DocumentManager.Instance.CurrentDBDocument
uiapp = DocumentManager.Instance.CurrentUIApplication
uidoc = uiapp.ActiveUIDocument
app = uiapp.Application
view = uidoc.ActiveView 


def query_all_elements_of_category(doc, cat):
    """Return all elements of a category from a document."""
    collector = db.FilteredElementCollector(doc)
    elements = collector.OfCategory(cat)\
                        .WhereElementIsNotElementType()\
                        .ToElements()
    return elements


# The inputs to this node will be stored as a list in the IN variables.
dataEnteringNode = IN

# Place your code below this line
duct_insulations = query_all_elements_of_category(
        doc=doc, cat=db.BuiltInCategory.OST_DuctInsulations)
        
# Assign your output to the OUT variable.
OUT = duct_insulations
# ----------------------------------------
watch_2 = Watch(find_all_duct_insulation)
find_all_rogue_duct_insulation = Python(IN[0]=full_insulation_cleanup)
# ---------- find_all_rogue_duct_insulation.python (60 lines) ----------
import collections
import clr
# Import RevitNodes
clr.AddReference("RevitNodes")
import Revit

# Import RevitAPI
clr.AddReference("RevitAPI")
clr.AddReference('RevitAPIUI')
import Autodesk
import Autodesk.Revit.DB as db

# Import Revit elements
from Revit.Elements import *

# Import DocumentManager
clr.AddReference("RevitServices")
import RevitServices
from RevitServices.Persistence import DocumentManager

# important vars, dynamo version
#-------------------------------
doc = DocumentManager.Instance.CurrentDBDocument
uiapp = DocumentManager.Instance.CurrentUIApplication
uidoc = uiapp.ActiveUIDocument
app = uiapp.Application
view = uidoc.ActiveView 

ElementHostPair = collections.namedtuple("ElementHostPair", ["element", "host"])

def query_all_elements_of_category(doc, cat):
    """Return all elements of a category from a document."""
    collector = db.FilteredElementCollector(doc)
    elements = collector.OfCategory(cat)\
                        .WhereElementIsNotElementType()\
                        .ToElements()
    return elements


def find_rogue_and_unhosted_elements(doc, elems):
    """Find all rogue and unhosted insulation elements."""
    unhosted_elements = []
    rogue_elements = []
    for element in elems:
        host_id = element.HostElementId
        host_element = doc.GetElement(host_id)
        if host_element is None:
            unhosted_elements.append(element)
        else:
            if element.WorksetId != host_element.WorksetId:
                rogue_elements.append(ElementHostPair(element, host_element))
    return rogue_elements, unhosted_elements

# Place your code below this line
# STEP 1: Inspect Model and summarize findings
duct_insulations = query_all_elements_of_category(doc=doc, cat=db.BuiltInCategory.OST_DuctInsulations)
rogue_duct, unhosted_duct = find_rogue_and_unhosted_elements(doc=doc, elems=duct_insulations)

# Assign your output to the OUT variable.
OUT = [rogue_duct, unhosted_duct]
# ----------------------------------------
watch_3 = Watch(find_all_rogue_duct_insulation)
find_all_rogue_pipe_insulation = Python(IN[0]=full_insulation_cleanup)
# ---------- find_all_rogue_pipe_insulation.python (60 lines) ----------
import collections
import clr
# Import RevitNodes
clr.AddReference("RevitNodes")
import Revit

# Import RevitAPI
clr.AddReference("RevitAPI")
clr.AddReference('RevitAPIUI')
import Autodesk
import Autodesk.Revit.DB as db

# Import Revit elements
from Revit.Elements import *

# Import DocumentManager
clr.AddReference("RevitServices")
import RevitServices
from RevitServices.Persistence import DocumentManager

# important vars, dynamo version
#-------------------------------
doc = DocumentManager.Instance.CurrentDBDocument
uiapp = DocumentManager.Instance.CurrentUIApplication
uidoc = uiapp.ActiveUIDocument
app = uiapp.Application
view = uidoc.ActiveView 

ElementHostPair = collections.namedtuple("ElementHostPair", ["element", "host"])

def query_all_elements_of_category(doc, cat):
    """Return all elements of a category from a document."""
    collector = db.FilteredElementCollector(doc)
    elements = collector.OfCategory(cat)\
                        .WhereElementIsNotElementType()\
                        .ToElements()
    return elements


def find_rogue_and_unhosted_elements(doc, elems):
    """Find all rogue and unhosted insulation elements."""
    unhosted_elements = []
    rogue_elements = []
    for element in elems:
        host_id = element.HostElementId
        host_element = doc.GetElement(host_id)
        if host_element is None:
            unhosted_elements.append(element)
        else:
            if element.WorksetId != host_element.WorksetId:
                rogue_elements.append(ElementHostPair(element, host_element))
    return rogue_elements, unhosted_elements

# Place your code below this line
# STEP 1: Inspect Model and summarize findings
pipe_insulations = query_all_elements_of_category(doc=doc, cat=db.BuiltInCategory.OST_PipeInsulations)
rogue_pipe, unhosted_pipe = find_rogue_and_unhosted_elements(doc=doc, elems=pipe_insulations)
    
# Assign your output to the OUT variable.
OUT = [rogue_pipe, unhosted_pipe]
# ----------------------------------------
watch_4 = Watch(find_all_rogue_pipe_insulation)
code_block = CodeBlock()
# ---------- code_block.designscript (4 lines) ----------
0;
 // rogue elements;
1;
 // unhosted elements;
# ----------------------------------------
getItemAtIndex = List.GetItemAtIndex(list=find_all_rogue_pipe_insulation, index=code_block.out0)
watch_5 = Watch(getItemAtIndex)
getItemAtIndex_2 = List.GetItemAtIndex(list=find_all_rogue_pipe_insulation, index=code_block.out1)
watch_6 = Watch(getItemAtIndex_2)
code_block_2 = CodeBlock()  # same code as code_block
getItemAtIndex_3 = List.GetItemAtIndex(list=find_all_rogue_duct_insulation, index=code_block_2.out0)
watch_7 = Watch(getItemAtIndex_3)
getItemAtIndex_4 = List.GetItemAtIndex(list=find_all_rogue_duct_insulation, index=code_block_2.out1)
watch_8 = Watch(getItemAtIndex_4)

# group: Outputs
number_of_rogue_pipe_insulations = List.Count(list=watch_5)
number_of_rogue_pipe_insulations_2 = Watch(number_of_rogue_pipe_insulations)  # graph output
number_of_unhosted_pipe = List.Count(list=watch_6)  # "Number of unhosted Pipe Insulations"
number_of_unhosted_pipe_2 = Watch(number_of_unhosted_pipe)  # "Number of unhosted Pipe Insulations"; graph output
number_of_rogue_duct_insulations = List.Count(list=watch_7)
number_of_rogue_duct_insulations_2 = Watch(number_of_rogue_duct_insulations)  # graph output
number_of_unhosted_duct = List.Count(list=watch_8)  # "Number of unhosted Duct Insulations"
number_of_unhosted_duct_2 = Watch(number_of_unhosted_duct)  # "Number of unhosted Duct Insulations"; graph output
