# Dynamo graph PipeRiserTagging.dyn (Dynamo 2.6.2.15705)

code_block = CodeBlock { "Port the Python Pipe Riser Tagging Workflow to Dynamo"; "by wrapping the Python code in Python Nodes."; }

# group: Inputs
clear_pipe_riser_tags = BoolSelector(true)
riser_tag_family_name = CodeBlock { "BHE_DE_PipeTag_FlowArrow"; }
tag_risers = BoolSelector(false)
correct_vent_tags = BoolSelector(false)
color_riser_tags = BoolSelector(false)

clear_pipe_riser_tags_python = Python(IN[0]=clear_pipe_riser_tags, IN[1]=riser_tag_family_name)  # "Clear Pipe Riser Tags Python Implementation"
# ---------- clear_pipe_riser_tags_python.python (69 lines) ----------
import collections
import clr
# Import RevitNodes
clr.AddReference("RevitNodes")
import Revit

# Import RevitAPI
clr.AddReference("RevitAPI")
clr.AddReference('RevitAPIUI')
import Autodesk
import Autodesk.Revit.DB as db

# Import Revit elements
from Revit.Elements import *

# Import DocumentManager
clr.AddReference("RevitServices")
import RevitServices
from RevitServices.Persistence import DocumentManager

# important vars, dynamo version
doc = DocumentManager.Instance.CurrentDBDocument
uiapp = DocumentManager.Instance.CurrentUIApplication
uidoc = uiapp.ActiveUIDocument
app = uiapp.Application
view = uidoc.ActiveView 

# The inputs to this node will be stored as a list in the IN variables.
should_run = IN[0]
TAG_FAMILY_NAME = IN[1]

def clear_pipe_riser_tags_in_view():
    """Clear all pipe riser tags in the current view."""
    # STEP 1: Get all pipe tags in the view
    tags = db.FilteredElementCollector(doc, view.Id)\
             .OfCategory(db.BuiltInCategory.OST_PipeTags)\
             .WhereElementIsNotElementType()\
             .ToElements()

    # STEP 2: Filter for BHE_DE pipe riser tags
    riser_tags = []
    for tag in tags:
        tag_type = doc.GetElement(tag.GetTypeId())
        tag_family_name = tag_type.get_Parameter(db.BuiltInParameter.SYMBOL_FAMILY_NAME_PARAM).AsString()
        if tag_family_name == TAG_FAMILY_NAME:
            riser_tags.append(tag)

    # STEP 3: Delete all BHE_DE pipe riser tags
    if len(riser_tags) == 0:
        return True
    transaction = db.Transaction(doc)
    transaction.Start("Riser Tagging - Clear")
    try:
        for riser_tag in riser_tags:
            doc.Delete(riser_tag.Id)
    except Exception as ex:
        transaction.RollBack()
        return False
    else:
        transaction.Commit()
        return True

success = None
if should_run:
	# Place your code below this line
	success = clear_pipe_riser_tags_in_view()
	
# Assign your output to the OUT variable.
OUT = success
# ----------------------------------------
script_template = Python()  # unwired: IN[0]
# ---------- script_template.python (37 lines) ----------
import collections
import clr
# Import RevitNodes
clr.AddReference("RevitNodes")
import Revit

# Import RevitAPI
clr.AddReference("RevitAPI")
clr.AddReference('RevitAPIUI')
import Autodesk
import Autodesk.Revit.DB as db

# Import Revit elements
from Revit.Elements import *

# Import DocumentManager
clr.AddReference("RevitServices")
import RevitServices
from RevitServices.Persistence import DocumentManager

# important vars, dynamo version
doc = DocumentManager.Instance.CurrentDBDocument
uiapp = DocumentManager.Instance.CurrentUIApplication
uidoc = uiapp.ActiveUIDocument
app = uiapp.Application
view = uidoc.ActiveView 

# The inputs to this node will be stored as a list in the IN variables.
should_run = IN[0]
success = None

if should_run:
	# Place your code below this line
	success = True
	
# Assign your output to the OUT variable.
OUT = success
# ----------------------------------------
and_ = And(bool0=clear_pipe_riser_tags_python, bool1=tag_risers)

# group: WORK IN PROGRESS...
watch = Watch(clear_pipe_riser_tags_python)
script_template_2 = Python(IN[0]=and_)  # same code as script_template
watch_2 = Watch(script_template_2)
and_2 = And(bool0=script_template_2, bool1=correct_vent_tags)
script_template_3 = Python(IN[0]=and_2)  # same code as script_template
watch_3 = Watch(script_template_3)
and_3 = And(bool0=script_template_3, bool1=color_riser_tags)
script_template_4 = Python(IN[0]=and_3)  # same code as script_template
watch_4 = Watch(script_template_4)
