# Dynamo graph Tag Riser Supply.dyn (Dynamo 1.3.2.2480)

# note: OUTPUTS
# note: OPERATIONS
# note: INPUTS

# group: PIPE TAGGING SCRIPT
# note: REVIT VERSION(S)
#  2018
# note: DYNAMO VERSION
#  2.0.1.0
# note: AUTHOR
#  Brian McCrink + Tom Ben-David
# note: DEPENDENCIES
#  This script requires the packages: clockwork
# note: DESCRIPTION
#  This script is made to tag a specified pipe type one view at a time.  The tag placement location is adjustable and is made to drastically reduce the time taken to properly shift and tag all of your pipes.  The built in Revit feature, "Tag All Not Tagged," will generate the tags, but place them inconveniently and will often tag unwanted pipes (vertical and or really small horizontal pipes).  The script is designed to place the defualt pipe tag into the model.  You may find the need to modify your tag family if the text is not aligned centrally to the pipe.

# group: Tolerance (feet) - Do not tag pipes less than "input" feet
code_block = CodeBlock { 1000; }

categories = Categories("PipeTags")
isTagged = Custom[Element.IsTagged](Tags_of_Category=categories)  # Checks if all Elements are tagged in the project; unwired: Elements_of_Category

# group: Get active view
current = Document.Current()
activeView = Document.ActiveView(current)

all_elements_in_active_view = ElementsInView()
getCategory = Element.GetCategory(all_elements_in_active_view)
string_from_object = FromObject(getCategory)
code_block_2 = CodeBlock { "Pipes"; }
eq = string_from_object == code_block_2
filterByBoolMask = List.FilterByBoolMask(list=all_elements_in_active_view, mask=eq)

# group: Pipes containing "input" in the system classifcation
code_block_3 = CodeBlock { "Hydronic Supply"; }

# group: Isolates the pipes that contain the input string in its system classification
code_block_4 = CodeBlock { "System Classification"; }
getParameterValueByName = Element.GetParameterValueByName(element=filterByBoolMask.in, parameterName=code_block_4)
contains = String.Contains(str=getParameterValueByName, searchFor=code_block_3)
filterByBoolMask_2 = List.FilterByBoolMask(list=filterByBoolMask.in, mask=contains)

# group: Grabs the geometry of each pipe
location = Custom[Element.Location+](element=filterByBoolMask_2.in)  # Returns the location of an element as point, curve or curve loop, along with some booleans to help filtering the results. Unlike the OOTB Element.GetLocation node, it also retunrs sketch lines of sketch-based elements like floor slabs as well as the element's rotation property.

# group: Tolerance (degrees)- to account for sloped pipework
code_block_5 = CodeBlock { 5; }

# group: Filter to include only horizontal or sloped pipework
direction = Line.Direction(location.curves)
ZAxis = Vector.ZAxis()
angleWithVector = Vector.AngleWithVector(vector=direction, otherVector=ZAxis)
code_block_6 = CodeBlock(x=code_block_5) { 90+x; 90-x; }
lt = angleWithVector < code_block_6.out0
gt = angleWithVector > code_block_6.out1
and_ = lt && gt

filterByBoolMask_3 = List.FilterByBoolMask(list=filterByBoolMask_2.in, mask=and_)
code_block_7 = CodeBlock { false; true; "Center"; }
byElement = Tag.ByElement(activeView, filterByBoolMask_3.out, code_block_7.out1, code_block_7.out0, code_block_7.out2, code_block_7.out2)  # frozen
length = Curve.Length(location.curves)
code_block_8 = CodeBlock { 1000; }
gt_2 = length > code_block_8
filterByBoolMask_4 = List.FilterByBoolMask(list=filterByBoolMask_3.out, mask=gt_2)
boolean = BoolSelector(true)
selectInView = Custom[Element.SelectInView](Element=filterByBoolMask_4.in, Refresh_Boolean=boolean)  # Select the input elements in active view. Disconnect / Connect to refresh.
