# Dynamo graph PIPES Query pipe runs.dyn (Dynamo 1.3.2.2480)

boolean = BoolSelector(true)
currentSelection = Custom[Springs.Collector.CurrentSelection](refresh=boolean)  # Gets the currently selected elements. Connect a boolean switch to refresh the selection.
category = Custom[Element.Category](element=currentSelection)  # This node will get the input element(s)' categories
code_block = CodeBlock { "Pipes"; }
eq = category == code_block
filterByBoolMask = List.FilterByBoolMask(list=currentSelection, mask=eq)
name = Element.Name(filterByBoolMask.out)
countOccurences = Custom[List.CountOccurences](seq=name)  # Counts the number of occurences of each unique element in a given list
code_block_2 = CodeBlock { "Length"; }
getParameterValueByName = Element.GetParameterValueByName(element=filterByBoolMask.in, parameterName=code_block_2)
mass_addition = Custom[Mass Addition](List=getParameterValueByName)  # This node will attempt to sum all elements contained within it.
watch = Watch(mass_addition)
