# Dynamo graph PIPES_ManipulateLevels1.dyn (Dynamo 1.3.2.2480)

categories = Categories("PipeCurves")
all_elements_of_category = ElementsOfCategory(categories)
code_block = CodeBlock { "System Classification"; }
getParameterValueByName = Element.GetParameterValueByName(element=all_elements_of_category, parameterName=code_block)
code_block_2 = CodeBlock { "hydronic"; true; }
contains = String.Contains(str=getParameterValueByName, searchFor=code_block_2.out0, ignoreCase=code_block_2.out1)
filterByBoolMask = List.FilterByBoolMask(list=all_elements_of_category, mask=contains)

# group: Grabs the geometry of each pipe
location = Custom[Element.Location+](element=filterByBoolMask.in)  # Returns the location of an element as point, curve or curve loop, along with some booleans to help filtering the results. Unlike the OOTB Element.GetLocation node, it also retunrs sketch lines of sketch-based elements like floor slabs as well as the element's rotation property.

code_block_3 = CodeBlock { 5; }

# group: Filter to include only horizontal or sloped pipework
direction = Line.Direction(location.curves)
ZAxis = Vector.ZAxis()
angleWithVector = Vector.AngleWithVector(vector=direction, otherVector=ZAxis)
code_block_4 = CodeBlock(x=code_block_3) { 90+x; 90-x; }
lt = angleWithVector < code_block_4.out0
gt = angleWithVector > code_block_4.out1
and_ = lt && gt

filterByBoolMask_2 = List.FilterByBoolMask(list=filterByBoolMask.in, mask=and_)
code_block_5 = CodeBlock(a=filterByBoolMask_2.in) { a=a; }  # frozen
code_block_6 = CodeBlock { "Offset"; "myOffset"; }
code_block_7 = CodeBlock { "Reference Level"; }
categories_2 = Categories("Levels")  # frozen
all_elements_of_category_2 = ElementsOfCategory(categories_2)
name = Level.Name(all_elements_of_category_2)
code_block_8 = CodeBlock { "RFB"; }
contains_2 = String.Contains(str=name, searchFor=code_block_8)

# group: do it only for one level
filterByBoolMask_3 = List.FilterByBoolMask(list=all_elements_of_category_2, mask=contains_2)

elevation = Level.Elevation(filterByBoolMask_3.in)
sortByKey = List.SortByKey(list=filterByBoolMask_3.in, keys=elevation)
getParameterValueByName_2 = Element.GetParameterValueByName(element=filterByBoolMask_2.in, parameterName=code_block_7)

# group: Absolute level
code_block_9 = CodeBlock { "Offset"; }
getParameterValueByName_3 = Element.GetParameterValueByName(element=filterByBoolMask_2.in, parameterName=code_block_9)
elevation_2 = Level.Elevation(getParameterValueByName_2)
add = getParameterValueByName_3 + elevation_2

# group: Compare absolute level to level elevations and assign the correct level
python_script = Python(IN[0]=sortByKey.sorted_keys)
# ---------- python_script.python (15 lines) ----------
import clr
clr.AddReference('ProtoGeometry')
from Autodesk.DesignScript.Geometry import *
#The inputs to this node will be stored as a list in the IN variables.
dataEnteringNode = IN
cumulative = []
ra = 0
for h in IN[0]:
	if h<0:
		cumulative.append(h)
	else:
		ra+=h
		cumulative.append(h)
#Assign your output to the OUT variable.
OUT = cumulative
# ----------------------------------------
gt_2 = add@L1 > python_script@L1  # lacing=CrossProduct
mass_addition = Custom[Mass Addition](List=gt_2)  # This node will attempt to sum all elements contained within it.

code_block_10 = CodeBlock(x=mass_addition) { x-1; }

# group (continued): Compare absolute level to level elevations and assign the correct level
getItemAtIndex = List.GetItemAtIndex(list=sortByKey.sorted_list, index=code_block_10)

setParameterByName = Element.SetParameterByName(element=code_block_5@L2, parameterName=code_block_7, value=getItemAtIndex@L2)
getParameterValueByName_4 = Element.GetParameterValueByName(element=setParameterByName, parameterName=code_block_6.out0)
setParameterByName_2 = Element.SetParameterByName(element=code_block_5@L2, parameterName=code_block_6.out1, value=getParameterValueByName_4@L2)
name_2 = Level.Name(sortByKey.sorted_list)
code_block_11 = CodeBlock { 0; }
count = Count(sortByKey.sorted_keys)
code_block_12 = CodeBlock { 1; }
sequence = Sequence(start=code_block_11, amount=count, step=code_block_12, lacing=Longest)  # frozen
code_block_13 = CodeBlock(X=sequence) { X+1; }
getItemAtIndex_2 = List.GetItemAtIndex(list=sortByKey.sorted_keys, index=code_block_13)
sub = getItemAtIndex_2 - sortByKey.sorted_keys
code_block_14 = CodeBlock { 10000; }
replaceNull = Custom[List.ReplaceNull](seq=sub, replacement=code_block_14)  # Replaces all null values within a given list with a substitute

# group: max offset per level
createDictionary = Lists.Dictionary.CreateDictionary(name_2, replaceNull)

name_3 = Level.Name(getParameterValueByName_2)
getValueFromDictionary = Lists.Dictionary.GetValueFromDictionary(createDictionary, name_3)
code_block_15 = CodeBlock { "pipeReferenceLevel"; }
setParameterByName_3 = Element.SetParameterByName(element=filterByBoolMask_2.in@L2, parameterName=code_block_15, value=name_3@L2)
name_4 = Level.Name(getItemAtIndex)
code_block_16 = CodeBlock { "_Filter Comments 02"; }
python_script_2 = Python(IN[0]=add)
# ---------- python_script_2.python (8 lines) ----------
import clr
clr.AddReference('ProtoGeometry')
from Autodesk.DesignScript.Geometry import *
#The inputs to this node will be stored as a list in the IN variables.
dataEnteringNode = IN

#Assign your output to the OUT variable.
OUT = [str(round(h/1000,2)) for h in IN[0]]
# ----------------------------------------
setParameterByName_4 = Element.SetParameterByName(element=filterByBoolMask_2.in@L2, parameterName=code_block_16, value=python_script_2@L2)
workset = Custom[Element.Workset](element=all_elements_of_category)  # Retrieves the workset of a given element
element_name_universal = Custom[Element.Name (Universal)](element=workset)  # Gets an element's name (Dynamo's built-in Name nodes don't work for all element types, e.g. worksets...)
worksets = WorksetUI("434_Kälte")
name_5 = Archilab.Grimshaw.Elements.Workset.Name(worksets)
eq = element_name_universal == name_5
