# Dynamo graph PIPESmovePipesToCorrectLevel.dyn (Dynamo 1.3.2.2480)

categories = Categories("PipeCurves")
all_elements_of_category = ElementsOfCategory(categories)
workset = Custom[Element.Workset](element=all_elements_of_category)  # Retrieves the workset of a given element
element_name_universal = Custom[Element.Name (Universal)](element=workset)  # Gets an element's name (Dynamo's built-in Name nodes don't work for all element types, e.g. worksets...)
worksets = WorksetUI("422_Heizung_Leitung")
name = Archilab.Grimshaw.Elements.Workset.Name(worksets)
eq = element_name_universal == name
filterByBoolMask = List.FilterByBoolMask(list=all_elements_of_category, mask=eq)
code_block = CodeBlock(a=filterByBoolMask.in) { a=a; }
code_block_2 = CodeBlock { "Offset"; "myOffset"; }
code_block_3 = CodeBlock { "Reference Level"; }
categories_2 = Categories("Levels")  # frozen
all_elements_of_category_2 = ElementsOfCategory(categories_2)
name_2 = Level.Name(all_elements_of_category_2)
code_block_4 = CodeBlock { "RFB"; }
contains = String.Contains(str=name_2, searchFor=code_block_4)

# group: do it only for one level
filterByBoolMask_2 = List.FilterByBoolMask(list=all_elements_of_category_2, mask=contains)

elevation = Level.Elevation(filterByBoolMask_2.in)
sortByKey = List.SortByKey(list=filterByBoolMask_2.in, keys=elevation)
getParameterValueByName = Element.GetParameterValueByName(element=filterByBoolMask.in, parameterName=code_block_3)

# group: Absolute level
code_block_5 = CodeBlock { "Offset"; }
getParameterValueByName_2 = Element.GetParameterValueByName(element=code_block, parameterName=code_block_5)
elevation_2 = Level.Elevation(getParameterValueByName)
add = getParameterValueByName_2 + elevation_2

# group: Compare absolute level to level elevations and assign the correct level
python_script = Python(IN[0]=sortByKey.sorted_keys)
# ---------- python_script.python (15 lines) ----------
import clr
clr.AddReference('ProtoGeometry')
from Autodesk.DesignScript.Geometry import *
#The inputs to this node will be stored as a list in the IN variables.
dataEnteringNode = IN
cumulative = []
ra = 0
for h in IN[0]:
	if h<0:
		cumulative.append(h)
	else:
		ra+=h
		cumulative.append(h)
#Assign your output to the OUT variable.
OUT = cumulative
# ----------------------------------------
gt = add@L1 > python_script@L1  # lacing=CrossProduct
mass_addition = Custom[Mass Addition](List=gt)  # This node will attempt to sum all elements contained within it.

code_block_6 = CodeBlock(x=mass_addition) { x-1; }

# group (continued): Compare absolute level to level elevations and assign the correct level
getItemAtIndex = List.GetItemAtIndex(list=sortByKey.sorted_list, index=code_block_6)

setParameterByName = Element.SetParameterByName(element=code_block@L2, parameterName=code_block_3, value=getItemAtIndex@L2)
getParameterValueByName_3 = Element.GetParameterValueByName(element=setParameterByName, parameterName=code_block_2.out0)
setParameterByName_2 = Element.SetParameterByName(element=code_block@L2, parameterName=code_block_2.out1, value=getParameterValueByName_3@L2)
name_3 = Level.Name(sortByKey.sorted_list)
code_block_7 = CodeBlock { 0; }
count = Count(sortByKey.sorted_keys)
code_block_8 = CodeBlock { 1; }
sequence = Sequence(start=code_block_7, amount=count, step=code_block_8, lacing=Longest)  # frozen
code_block_9 = CodeBlock(X=sequence) { X+1; }
getItemAtIndex_2 = List.GetItemAtIndex(list=sortByKey.sorted_keys, index=code_block_9)
sub = getItemAtIndex_2 - sortByKey.sorted_keys
code_block_10 = CodeBlock { 10000; }
replaceNull = Custom[List.ReplaceNull](seq=sub, replacement=code_block_10)  # Replaces all null values within a given list with a substitute

# group: max offset per level
createDictionary = Lists.Dictionary.CreateDictionary(name_3, replaceNull)

name_4 = Level.Name(getParameterValueByName)
getValueFromDictionary = Lists.Dictionary.GetValueFromDictionary(createDictionary, name_4)
code_block_11 = CodeBlock { "pipeReferenceLevel"; }
name_5 = Level.Name(getItemAtIndex)
setParameterByName_3 = Element.SetParameterByName(element=setParameterByName@L2, parameterName=code_block_11, value=name_5@L2)
code_block_12 = CodeBlock { "_Filter Comments 02"; }
python_script_2 = Python(IN[0]=add)
# ---------- python_script_2.python (8 lines) ----------
import clr
clr.AddReference('ProtoGeometry')
from Autodesk.DesignScript.Geometry import *
#The inputs to this node will be stored as a list in the IN variables.
dataEnteringNode = IN

#Assign your output to the OUT variable.
OUT = [str(round(h)) for h in IN[0]]
# ----------------------------------------
setParameterByName_4 = Element.SetParameterByName(element=code_block@L2, parameterName=code_block_12, value=python_script_2@L2)
