# Dynamo graph Pipe Tagging Script.dyn (Dynamo 1.3.4.6666)

# group: PIPE TAGGING SCRIPT
# note: REVIT VERSION(S)
#  2018
# note: DYNAMO VERSION
#  2.0.1.0
# note: AUTHOR
#  Brian McCrink + Tom Ben-David
# note: DEPENDENCIES
#  This script requires the packages: clockwork
# note: DESCRIPTION
#  This script is made to tag a specified pipe type one view at a time.  The tag placement location is adjustable and is made to drastically reduce the time taken to properly shift and tag all of your pipes.  The built in Revit feature, "Tag All Not Tagged," will generate the tags, but place them inconveniently and will often tag unwanted pipes (vertical and or really small horizontal pipes).  The script is designed to place the defualt pipe tag into the model.  You may find the need to modify your tag family if the text is not aligned centrally to the pipe.

# group: Select view to tag
views = Views("Documentation - Level 01 - Drainage")

# group: Pipes containing "input" in the system classifcation
code_block = CodeBlock { "Sanitary"; }

# group: Isolates the pipes that contain the input string in its system classification
categories = Categories("PipeCurves")
all_elements_of_category = ElementsOfCategory(categories)
code_block_2 = CodeBlock { "System Classification"; }
getParameterValueByName = Element.GetParameterValueByName(element=all_elements_of_category, parameterName=code_block_2)
contains = String.Contains(str=getParameterValueByName, searchFor=code_block)
filterByBoolMask = List.FilterByBoolMask(list=all_elements_of_category, mask=contains)

# group: Grabs the geometry of each pipe
location = Custom[Element.Location+](element=filterByBoolMask.in)  # Returns the location of an element as point, curve or curve loop, along with some booleans to help filtering the results. Unlike the OOTB Element.GetLocation node, it also retunrs sketch lines of sketch-based elements like floor slabs as well as the element's rotation property.

# group: Tolerance (feet) - Do not tag pipes less than "input" feet
code_block_3 = CodeBlock { 1000; }

# group: Tolerance (degrees)- to account for sloped pipework
# note: OUTPUTS
# note: OPERATIONS
# note: INPUTS
code_block_4 = CodeBlock { 5; }

# group: Filter to include only horizontal or sloped pipework
direction = Line.Direction(location.curves)
ZAxis = Vector.ZAxis()
angleWithVector = Vector.AngleWithVector(vector=direction, otherVector=ZAxis)
code_block_5 = CodeBlock(x=code_block_4) { 90+x; 90-x; }
lt = angleWithVector < code_block_5.out0
gt = angleWithVector > code_block_5.out1
and_ = lt && gt

# group: Filter to inlcude only pipes greater than a specified length
length = Curve.Length(location.curves)
gt_2 = length > code_block_3
and_2 = gt_2 && and_

# group: Creates list of pipes after both filters
filterByBoolMask_2 = List.FilterByBoolMask(list=filterByBoolMask.in, mask=and_2)

# group: Locates and generates the midpoint for each pipe
filterByBoolMask_3 = List.FilterByBoolMask(list=location.curveEndpoints, mask=and_2)
firstItem = List.FirstItem(filterByBoolMask_3.in@L2)
Z = Point.Z(firstItem)
X = Point.X(firstItem)
lastItem = List.LastItem(filterByBoolMask_3.in@L2)
X_2 = Point.X(lastItem)
code_block_6 = CodeBlock(x=X, y=X_2) { (x+y)/2; }
Y = Point.Y(firstItem)
Y_2 = Point.Y(lastItem)
code_block_7 = CodeBlock(x=Y, y=Y_2) { (x+y)/2; }
byCoordinates = Point.ByCoordinates(x=code_block_6, y=code_block_7, z=Z)

# group: Isolates the pipes that only exist in your selected view
categories_2 = Categories("Levels")
all_elements_of_category_2 = ElementsOfCategory(categories_2)
projectElevation = Level.ProjectElevation(all_elements_of_category_2)
sortByKey = List.SortByKey(list=all_elements_of_category_2, keys=projectElevation)
gt_3 = Z > sortByKey.sorted_keys  # lacing=CrossProduct
boolean = BoolSelector(false)
indexOf = IndexOf(gt_3@L2, boolean)
code_block_8 = CodeBlock(x=indexOf) { x-1; }
name = Level.Name(sortByKey.sorted_list)
code_block_9 = CodeBlock { "Associated Level"; }
getParameterValueByName_2 = Element.GetParameterValueByName(element=views, parameterName=code_block_9)
indexOf_2 = IndexOf(name, getParameterValueByName_2)
eq = code_block_8 == indexOf_2
filterByBoolMask_4 = List.FilterByBoolMask(list=filterByBoolMask_2.in, mask=eq)
count = Count(filterByBoolMask_4.in)
cycle = List.Cycle(list=views, amount=count)

# group: Tag distance from pipe (ft)
code_block_10 = CodeBlock { 200; }

# group: Locates the vector normal to pipe direction and specifies the direction of the vector (+/-) using the absoulte value
filterByBoolMask_5 = List.FilterByBoolMask(list=direction, mask=and_2)
ZAxis_2 = Vector.ZAxis()
cross = Vector.Cross(vector=filterByBoolMask_5.in, cross=ZAxis_2)
normalized = Vector.Normalized(cross)
scale = Vector.Scale(vector=normalized, scale_factor=code_block_10)
X_3 = Vector.X(scale)
code_block_11 = CodeBlock(x=X_3) { -Math.Abs(x); }
Y_3 = Vector.Y(scale)
code_block_12 = CodeBlock(x=Y_3) { Math.Abs(x); }

# group: Creates a point translated from the pipe midpoint in the direction of the generated vector
translate = Geometry.Translate(geometry=byCoordinates, xTranslation=code_block_11, yTranslation=code_block_12)

# group: Filter to inlcude only pipes located within the selected view
filterByBoolMask_6 = List.FilterByBoolMask(list=translate, mask=eq)

boolean_2 = BoolSelector(true)

# group: Outputs default pipe tag at created points for the pipes in selected view.
byElementAndLocation = Tag.ByElementAndLocation(view=cycle, element=filterByBoolMask_4.in, location=filterByBoolMask_6.in, horizontal=boolean_2)

watch = Watch(location.curves)
