# Dynamo graph TAG Pipe Tagging Script rev jz.dyn (Dynamo 1.3.2.2480)

# group: PIPE TAGGING SCRIPT
# note: REVIT VERSION(S)
#  2018
# note: DYNAMO VERSION
#  2.0.1.0
# note: AUTHOR
#  Brian McCrink + Tom Ben-David
# note: DEPENDENCIES
#  This script requires the packages: clockwork
# note: DESCRIPTION
#  This script is made to tag a specified pipe type one view at a time.  The tag placement location is adjustable and is made to drastically reduce the time taken to properly shift and tag all of your pipes.  The built in Revit feature, "Tag All Not Tagged," will generate the tags, but place them inconveniently and will often tag unwanted pipes (vertical and or really small horizontal pipes).  The script is designed to place the defualt pipe tag into the model.  You may find the need to modify your tag family if the text is not aligned centrally to the pipe.

all_elements_in_active_view = ElementsInView()
getCategory = Element.GetCategory(all_elements_in_active_view)
string_from_object = FromObject(getCategory)
code_block = CodeBlock { "Pipes"; }
eq = string_from_object == code_block
filterByBoolMask = List.FilterByBoolMask(list=all_elements_in_active_view, mask=eq)

# group: Pipes containing "input" in the system classifcation
code_block_2 = CodeBlock { "Hydronic"; }

# group: Isolates the pipes that contain the input string in its system classification
code_block_3 = CodeBlock { "System Classification"; }
getParameterValueByName = Element.GetParameterValueByName(element=filterByBoolMask.in, parameterName=code_block_3)
contains = String.Contains(str=getParameterValueByName, searchFor=code_block_2)
filterByBoolMask_2 = List.FilterByBoolMask(list=filterByBoolMask.in, mask=contains)

# group: Grabs the geometry of each pipe
location = Custom[Element.Location+](element=filterByBoolMask_2.in)  # Returns the location of an element as point, curve or curve loop, along with some booleans to help filtering the results. Unlike the OOTB Element.GetLocation node, it also retunrs sketch lines of sketch-based elements like floor slabs as well as the element's rotation property.

# group: Tolerance (feet) - Do not tag pipes less than "input" feet
code_block_4 = CodeBlock { 500; }

# group: Tolerance (degrees)- to account for sloped pipework
code_block_5 = CodeBlock { 5; }

# group: Filter to include only horizontal or sloped pipework
direction = Line.Direction(location.curves)
ZAxis = Vector.ZAxis()
angleWithVector = Vector.AngleWithVector(vector=direction, otherVector=ZAxis)
code_block_6 = CodeBlock(x=code_block_5) { 90+x; 90-x; }
lt = angleWithVector < code_block_6.out0
gt = angleWithVector > code_block_6.out1
and_ = lt && gt

# group: Filter to inlcude only pipes greater than a specified length
length = Curve.Length(location.curves)
gt_2 = length > code_block_4
and_2 = gt_2 && and_

# group: Locates and generates the midpoint for each pipe
filterByBoolMask_3 = List.FilterByBoolMask(list=location.curveEndpoints, mask=and_2)
firstItem = List.FirstItem(filterByBoolMask_3.in@L2)
X = Point.X(firstItem)
lastItem = List.LastItem(filterByBoolMask_3.in@L2)
X_2 = Point.X(lastItem)
code_block_7 = CodeBlock(x=X, y=X_2) { (x+y)/2; }
Y = Point.Y(firstItem)
Y_2 = Point.Y(lastItem)
code_block_8 = CodeBlock(x=Y, y=Y_2) { (x+y)/2; }
Z = Point.Z(firstItem)
byCoordinates = Point.ByCoordinates(x=code_block_7, y=code_block_8, z=Z)

# group: Tag distance from pipe (ft)
code_block_9 = CodeBlock { 100; }

# group: Locates the vector normal to pipe direction and specifies the direction of the vector (+/-) using the absoulte value
filterByBoolMask_4 = List.FilterByBoolMask(list=direction, mask=and_2)  # frozen
ZAxis_2 = Vector.ZAxis()
cross = Vector.Cross(vector=filterByBoolMask_4.in, cross=ZAxis_2)
normalized = Vector.Normalized(cross)
scale = Vector.Scale(vector=normalized, scale_factor=code_block_9)
X_3 = Vector.X(scale)
code_block_10 = CodeBlock(x=X_3) { -Math.Abs(x); }
Y_3 = Vector.Y(scale)
code_block_11 = CodeBlock(x=Y_3) { Math.Abs(x); }

# group: Creates a point translated from the pipe midpoint in the direction of the generated vector
translate = Geometry.Translate(geometry=byCoordinates, xTranslation=code_block_10, yTranslation=code_block_11)

# group: Get active view
# note: OUTPUTS
# note: OPERATIONS
# note: INPUTS
current = Document.Current()
activeView = Document.ActiveView(current)

all_pipes_at_reference_level = Custom[All Pipes at Reference Level](Level=activeView)  # This will collect all pipes by their reference level.

# group: Creates list of pipes after both filters
filterByBoolMask_5 = List.FilterByBoolMask(list=filterByBoolMask_2.in, mask=and_2)

X_4 = Point.X(byCoordinates)
code_block_12 = CodeBlock { 100; }
add = X_4 + code_block_12
Y_4 = Point.Y(byCoordinates)
code_block_13 = CodeBlock { 50; }
add_2 = Y_4 + code_block_13
Z_2 = Point.Z(byCoordinates)
byCoordinates_2 = Point.ByCoordinates(x=add, y=add_2, z=Z_2)
boolean = BoolSelector(true)
boolean_2 = BoolSelector(true)

# group: Outputs default pipe tag at created points for the pipes in selected view.
byElementAndLocation = Tag.ByElementAndLocation(view=activeView, element=filterByBoolMask_5.in, location=byCoordinates_2, horizontal=boolean, addLeader=boolean_2)

getHeadPosition = Rhythm.Revit.Elements.Tag.GetHeadPosition(byElementAndLocation)
Y_5 = Point.Y(getHeadPosition)
Z_3 = Point.Z(byCoordinates_2)
byCoordinates_3 = Point.ByCoordinates(x=code_block_7, y=Y_5, z=Z_3)
setLeaderElbowPosition = Rhythm.Revit.Elements.Tag.SetLeaderElbowPosition(byElementAndLocation, byCoordinates_3)
